# Grasshopper definition massing.gh (Grasshopper 1.0.7)

z_dir = GetNumber(Slider(1.2, range=0..10), AtLeast=1, AtMost=1, Maximum=1.797693135e+308, Minimum=-1.797693135e+308, TreeAccess=False)
geo = Geometry([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])
scale_nu = ScaleNU(Geometry=geo, Plane=PlaneXY(0, 0, 0), ScaleX=1, ScaleY=1, ScaleZ=z_dir)  # -> Geometry, Transform
geo_2 = Geometry(scale_nu.Geometry)
context_bake = ContextBake(Geometry=geo_2)
